# Grasshopper definition alembic-test.gh (Grasshopper 1.0.7)
# plug-ins: GhAlembic Info, ghWebSocket Info, GhViewportMonitor Info

number_slider = Slider(0.3, range=0.01..1)
path = FilePath("/Users/mnmly/Downloads/test-2.abc")
path_2 = FilePath("C:\Users\mnmly\Downloads\test.abc")
number_slider_2 = Slider(50, range=4..50)
c_script = CSharpScript(x=path, y=path_2)  # -> out, A
# ---------- c_script: C# ----------
int p = (int) System.Environment.OSVersion.Platform;
bool IsLinux = (p == 4) || (p == 6) || (p == 128);
A = IsLinux ? x : y;
# ---------- end c_script ----------
number_slider_3 = Slider(200, range=0..200)
panel = Panel(c_script.A)
planesrf = PlaneSurface(Plane=PlaneXY(0, 0, 0), XSize="-0.5 To 0.5", YSize="-0.5 To 0.5")
box = CenterBox(Base=PlaneXY(0, 0, 0), X=number_slider, Y=number_slider, Z=1)
sph = Sphere(Base=PlaneXY(0, 0, 0), Radius=Slider(0.59, range=0.01..10))
sunion = SolidUnion(Breps=[planesrf, box])
websocket_client = WebSocketClient(Host="localhost", Port="1235")
dom = ConstructDomain(DomainStart=Slider(0.1, range=0.1..10), DomainEnd=Slider(2.5, range=0.1..10))
geo = Geometry(sunion)
data = Data(websocket_client)
socket_state = SocketState(Socket=data)
num = Number(Slider(545, range=100..1000))
panel_2 = Panel(socket_state)
minitor_viewport_info_and_send_via_webso = MonitorViewport(Socket=data, CameraName="Camera", MonitorIntervalMs=Slider(100, range=0..100))  # "Minitor Viewport Info and send via WebSocket"
series = Series(Start=0, Step=Slider(0.32, range=0.01..1), Count=num)
rad = Radians(Degrees=Slider(47, range=0..360))
rotate = Rotate(Geometry=geo, Angle=rad, Plane=PlaneXY(0, 0, 0))  # -> Geometry, Transform
Z = UnitZ(Factor=Slider(0.4, range=0..10))
multiplication = Multiplication(A=num, B=3)
Y = UnitY(Factor=series)
move = Move(Geometry=rotate.Geometry, Motion=Z)  # -> Geometry, Transform
random = Random(Range=Domain(0, 1), Number=multiplication, Seed=Slider(75, range=0..1000))
subtraction = Subtraction(A=num, B=1)
num2pt = NumbersToPoints(Numbers=random, Mask=4)
range = Range(Domain=dom, Steps=subtraction)
unit = UnitVector(Vector=num2pt)
multiplication_2 = Multiplication(A=unit, B=Slider(5, range=-5..5))
zero_point = ZeroPoint()
move_2 = Move(Geometry=geo, Motion=multiplication_2)  # -> Geometry, Transform
ln = Line(StartPoint=zero_point, EndPoint=unit)
scale = Scale(Geometry=move_2.Geometry, Center=Point(0, 0, 0), Factor=range)  # -> Geometry, Transform
rotax = RotateAxis(Geometry=scale.Geometry, Angle=range, Axis=ln)  # -> Geometry, Transform
move_3 = Move(Geometry=rotax.Geometry, Motion=Y)  # -> flatten(Geometry), Transform
merge = Merge(Data1=move.Geometry, Data2=move_3.Geometry)  # -> flatten(Result)
panel_3 = Panel("""Metal
Wood""")
long = LongestList(ListA=merge, ListB=panel_3, PaddingMode=2)  # -> ListA, ListB
export_alembic = ExportAsAlembic(
    Mesh=merge,
    MaterialNames=long.ListB,
    OutputPath=c_script.A,
    FlipAxis=True,
    Socket=data,
    CollectionName="Misc_collection")

# ==== cluster ZeroPoint
zero = Point("{0,0,0}")
zero_2 = ClusterOutput(zero)
