# Grasshopper definition curve-test.gh (Grasshopper 1.0.7)
# plug-ins: ghTempFile, GhAlembic Info, ghWebSocket Info

curve = Curve(<curve referenced from the Rhino model>)
curve_2 = Curve(<curve referenced from the Rhino model>)
curve_3 = Curve(<curve referenced from the Rhino model>)
curve_4 = Curve(<curve referenced from the Rhino model>)
curve_5 = Curve(<curve referenced from the Rhino model>)
curve_6 = Curve(<curve referenced from the Rhino model>)
c_script = CSharpScript(x=curve)  # -> out, A, B, C; inputs x: Curve, z: Point3d
# ---------- c_script: C# ----------
    var c = x.ToNurbsCurve();
    var circular = x as ArcCurve;
    A = x;
    var cc = new NurbsCurve(3, 8);
    for (var i = 0; i < cc.Points.Count; i++){
      var phase = (double) i / (double)(cc.Points.Count) * Math.PI * 2.0;
      var _x = Math.Cos(phase);
      var _y = Math.Sin(phase);
      var weight = 1.0;
      if (i % 2 == 1) {
        weight = 1.0 - 1.0 / Math.Sqrt(2.0);
      }
      var p = new Point3d(_x, _y, 0) * circular.Arc.Radius;
      p = (Point3d)(circular.Arc.Plane.XAxis * p.X + circular.Arc.Plane.YAxis * p.Y + circular.Arc.Plane.ZAxis * p.Z);
      p += circular.Arc.Center;
      cc.Points.SetPoint(i, p);
      cc.Points.SetWeight(i, weight);
      Print("{0}", (double) i / (double)(cc.Points.Count));
    }
    C = cc;
    var points = new List<double>();
    var weights = new List<double>();
    for (var i = 0; i < c.Points.Count; i++){
      if (i % 2 == 0) {
        var p = new Point3d();

        points.Add(c.Points[i].X - p.X);
        points.Add(c.Points[i].Y - p.Y);
        points.Add(c.Points[i].Z - p.Z);
      } else {
        var p = new Point3d(circular.Arc.Center);
        p.X *= 1.0 - c.Points[i].Weight;
        p.Y *= 1.0 - c.Points[i].Weight;
        p.Z *= 1.0 - c.Points[i].Weight;
        points.Add(c.Points[i].X + p.X);
        points.Add(c.Points[i].Y + p.Y);
        points.Add(c.Points[i].Z + p.Z);
      }
      weights.Add(c.Points[i].Weight);
    }
    for (var i = 0; i < c.Points.Count; i++){
      var w = 1.0;
      c.Points.SetPoint(i, points[i * 3 + 0], points[i * 3 + 1], points[i * 3 + 2], w);
    }
    //C = c;
    B = points;
# ---------- end c_script ----------
curve_7 = Curve(c_script.C)
control_points = ControlPoints(Curve=curve_7)  # -> Points, Weights, Knots
merge = Merge(Data1=curve_2, Data2=curve_5, Data3=curve_4, Data4=curve_3, Data5=curve, Data6=curve_6)
curve_8 = Curve(c_script.C)
c_script_2 = CSharpScript(x=curve_8)  # -> out, A; inputs x: Curve
# ---------- c_script_2: C# ----------
    Print("{0}", x.Degree);
# ---------- end c_script_2 ----------
websocket_client = WebSocketClient(Host="localhost", Port="1235", Reconnect=Button())
temp_file = TempFile(Extension="tmp", Refresh=False)
panel = Panel(c_script.out)
panel_2 = Panel("""degree-4
degree-3
degree-2
degree-1""")
panel_3 = Panel(c_script_2.out)
numbers_to_points = NumbersToPoints(Numbers=c_script.B, Mask=4)
number_slider = Slider(0.5, range=0.1..100)
point_list = PointList(Points=control_points.Points, Size=number_slider)
export_as_alembic = ExportAsAlembic(
    Geometry=merge,
    ObjectNames=panel_2,
    OutputPath=temp_file,
    FlipAxis=True,
    Socket=websocket_client,
    CollectionName="Collection-Grasshopper")
panel_4 = Panel(numbers_to_points)
point_list_2 = PointList(Points=numbers_to_points, Size=number_slider)
