# Grasshopper definition mesh-test.gh (Grasshopper 1.0.7)
# plug-ins: Human

xy = XYPlane(Origin=Point(0, 0, 0))
box = CenterBox(Base=PlaneXY(0, 0, 0), X=1, Y=1, Z=1)
msphere = MeshSphere(Base=PlaneXY(0, 0, 0), Radius=10, UCount=10, VCount=20)
mesh = Mesh(box)
sphericalmap = SphericalMapping(Mesh=msphere, BasePlane=xy)  # -> MappedMesh, MappingSphere
boxmap = BoxMapping(Mesh=mesh, Box=box)
c_script = CSharpScript(x=sphericalmap.MappedMesh)  # -> out, A, B, C, D; inputs x: Mesh
# ---------- c_script: C# ----------
x.Normals.ComputeNormals();

A = x.Vertices.ToFloatArray();
B = x.TextureCoordinates.ToFloatArray();
C = x.Normals.ToFloatArray();
D = x.Faces.ToIntArray(true);
Print("{0}", x.Faces[0].D == x.Faces[0].C);
# ---------- end c_script ----------
panel = Panel(c_script.out)
join = TextJoin(Text=c_script.D, Join=",")
join_2 = TextJoin(Text=c_script.A, Join=",")
join_3 = TextJoin(Text=c_script.B, Join=",")
num2pt = NumbersToPoints(Numbers=c_script.B, Mask="XY")
join_4 = TextJoin(Text=c_script.C, Join=",")
panel_2 = Panel(join_2)
panel_3 = Panel(join)
panel_4 = Panel(join_3)
panel_5 = Panel(join_4)
